# Grasshopper definition 11_Ro_Wall_Off Axis.gh (Grasshopper 1.0.8)
# plug-ins: Pufferfish, Rhino.Inside for Autodesk Revit

doubleclick = BooleanToggle(False)
dss_annotation_panel = Panel("Help on WhiteWork")
# Segment
# group modules into larger coherent parts
# User Interface: I/O
dss_log_v5_2 = PythonScript(Help=doubleclick)  # inputs Help: Boolean
# ---------- dss_log_v5_2: Python ----------
"""
Set grasshopper template and provide easy acces to Help file in intranet

"""

"""
Credits:
    20211117
    Created by Vladimir Ondejcik
    White arkitekter AB

Based on:
    WOMBAT version <0.0.1>
    Script by <Brian Ringley>
        def libraries() by <Giulio Piacentino> see <http://www.grasshopper3d.com/forum/topics/gh-filename-is-python>
        def writeToFile() by <Data Analytics Society> see <https://www.youtube.com/watch?v=-TF3mXhnCDw>
    Script version <15 September 2015> 
    Copyright <Creative Commons Sharealike>
"""


#add dsearch default path located on cad.local
import sys
new_path = r"\\sesthfs02\DSEARCH\REPOSITORY\Grasshopper\Xtras\DsearchCode"
if new_path not in sys.path: sys.path.append(new_path)

#import dsearch plugin
import dsearch as ds

import os

print sys.path

#reload module (this has use when working on module)
#reload(ds.DS_Log)
#reload(ds.DS_Links)

#setup template
template=ds.DS_Links.Template
ds.DS_Log.DS_Template(template)

#run help from module 
if Help:
    helpLink=ds.DS_Links.HelpLink
    ds.DS_Log.DS_Help(helpLink)

    #turn toggle back to false
    obj=ghenv.Component.Params.Input[0].Sources[0]
    obj.Value=False
    obj.ExpireSolution(True)
# ---------- end dss_log_v5_2 ----------

dss_projectnumber = Panel("0000")
dss_projectname = Panel("name")

# ----
# Organization of Grasshopper scripts at White:
# Script should be created and annotated always with notion that other person will need to use/edit them.
# Build your script in modules and segments, use color coding and annotation according this template.
# This standard should be applied to all scripts, big or small.
# 
# Read  guide on white work:
# "https://work.white.se/grasshopper-developer-guide/"
# For Advanced users:
# For design scripts running more than a month use "dsInitialize" and "dsScriptLog" functions on Dsearch tab to log changes over time.
dss_annotation_panel_2 = Panel("""Tip of a day:
You can change default colour grups by right clicking
Graphical templates are located on "Dsearch" tab""")
# GRAPHIC
# STANDARD
# In
# data and geometry import from rhino or external platforms
image = ImageSampler(dss_annotation_panel_2, Filter="Colour", Interpolate=False, Umax=1, Umin=0, Vmax=1, Vmin=0, Wrap=0)

active_selection = GraphicalElement()

# ---- group: Make sure only walls enter
query_categories = QueryCategories(Type=1, Name="Walls", IsVisibleUI=True, IsSubcategory=False)
category_filter = CategoryFilter(Categories=query_categories, Inverted=False)
filter_elements = FilterElements(Elements=active_selection, Filter=category_filter)
cull_pattern = CullPattern(List=active_selection, CullPattern=filter_elements)
graphical_element = GraphicalElement(cull_pattern)

# ----
# Might snap to the wrong grid...
query_grids = QueryGrids()
line = Line(query_grids)

# ---- group: Remove Groups
active_selection_2 = GraphicalElement(graphical_element)
line_2 = Line(active_selection_2)
null_item = NullItem(Item=line_2)  # -> NullFlags, InvalidFlags, Description
cull_pattern_2 = CullPattern(List=active_selection_2, CullPattern=invert(null_item.NullFlags))
graphical_element_2 = GraphicalElement(simplify(graft(cull_pattern_2)))

# ---- group: Only grids in active view. To simplify calculations and enable to exclude grids
active_view = ActiveView()
visible_in_view_filter = VisibleInViewFilter(View=active_view, Inverted=False)
filter_elements_2 = FilterElements(Elements=query_grids, Filter=visible_in_view_filter)
cull_pattern_3 = CullPattern(List=query_grids, CullPattern=filter_elements_2)

# ----
# Control
# General
# Monitor
# Out
# variable parameters and script execution
# (sliders, boolean togggle, text input,...)
# monitor data and geometry preview (used for panels for example)
# output data to rhino or external platforms
# WIP
# Annotation
# Plugin
# general annotation and notes
# textbased scripting and special plugins
# f.ex: HumanUI, kangaroo,...
# problematic or under repair or construction
dss_annotation_panel_3 = Panel("general development modules")

# ---- group: Check if vector of wall coincides with vector of a gridline
graphical_element_3 = GraphicalElement(simplify(graft(graphical_element_2)))
line_3 = Line(cull_pattern_3)
vector = Vector(unitize(line_3))
negative = Negative(Value=vector)
line_4 = Line(graphical_element_3)
vector_2 = Vector(unitize(line_4))
create_set = CreateSet(List=flatten([negative, vector]))  # -> Set, Map
set_difference = SetDifference(SetA=graft(vector_2), SetB=create_set.Set)  # -> simplify(Union)
list_length = ListLength(List=set_difference)
boolean = Boolean(list_length)
cull_pattern_4 = CullPattern(List=graphical_element_3, CullPattern=boolean)
line_5 = Line(cull_pattern_4)

# ---- group: Line and vector from wall
# Back-end
line_6 = Line(graphical_element_2)

# ---- group: Choose the grid to compare angle with
vector_3 = Vector(unitize(vector))
vector_4 = Vector(line_5)
dot_product = DotProduct(VectorA=unitize(vector_4), VectorB=unitize(flatten(vector)), Unitize=vector_3)
absolute = Absolute(Value=dot_product)
subtraction = Subtraction(A=absolute, B="1")
absolute_2 = Absolute(Value=subtraction)
sort_list = SortList(Keys=absolute_2, ValuesValuesA=vector)  # -> Keys, ValuesValuesA
list_item = ListItem(List=sort_list.ValuesValuesA, Index=0, Wrap=True)  # -> simplify(Item)

# ---- group: Compare angle between wall and grid - if larger than given angle -cull
vector_5 = Vector(list_item)
line_7 = Line(cull_pattern_4)
negative_2 = Negative(Value=vector_5)
vector_6 = Vector(line_7)
angle = Angle(VectorA=vector_6, VectorB=negative_2)  # -> Angle, Reflex
angle_2 = Angle(VectorA=vector_6, VectorB=vector_5)  # -> Angle, Reflex
degrees = Degrees(Radians=[angle_2.Angle, angle.Angle, angle_2.Reflex, angle.Reflex])
sort_list_2 = SortList(Keys=degrees)  # -> Keys, ValuesValuesA
list_item_2 = ListItem(List=sort_list_2.Keys, Index=0, Wrap=True)
larger_than = LargerThan(FirstNumber=list_item_2, SecondNumber="1")  # -> LargerThan, OrEqualTo
vector_7 = Vector(unitize(list_item))
cull_pattern_5 = CullPattern(List=vector_7, CullPattern=invert(larger_than.LargerThan))

# ---- group: Construct new line along grid vector
graphical_element_4 = GraphicalElement(cull_pattern_4)
vector_8 = Vector(cull_pattern_5)
line_8 = Line(graphical_element_4)
# Problems with walls with a lot of windows/ doors etc, Somehow they lose their host and is deleted.
curve_middle = CurveMiddle(Curve=line_8)
number_slider = Slider(1, range=0..1)
deconstruct = Deconstruct(Point=curve_middle)  # -> XComponent, YComponent, ZComponent
round_to_decimal_place = RoundToDecimalPlace(NumberX=deconstruct.YComponent, DecimalPlace=number_slider, RoundType=0)  # -> Rounded, Difference
round_to_decimal_place_2 = RoundToDecimalPlace(NumberX=deconstruct.XComponent, DecimalPlace=number_slider, RoundType=0)  # -> Rounded, Difference
length = Length(Curve=line_8)
construct_point = ConstructPoint(
    XCoordinate=round_to_decimal_place_2.Rounded,
    YCoordinate=round_to_decimal_place.Rounded,
    ZCoordinate=deconstruct.ZComponent)
division = Division(A=length, B=Slider(2, range=0..10))
line_sdl = LineSDL(Start=simplify(graft(construct_point)), Direction=vector_8, Length=simplify(graft(length)))
multiplication = Multiplication(A=vector_8, B=simplify(graft(division)))
negative_3 = Negative(Value=multiplication)
move = Move(Geometry=line_sdl, Motion=negative_3)  # -> Geometry, Transform
flip_curve = FlipCurve(Curve=move.Geometry, Guide=simplify(graft(line_8)))  # -> reparameterize(Curve), Flag
list_length_2 = ListLength(List=flatten(flip_curve.Curve))
boolean_2 = Boolean(list_length_2)
stream_filter = StreamFilter(Gate=boolean_2, Stream1=flip_curve.Curve)

# ----
graphical_element_5 = GraphicalElement(cull_pattern_4)

element_passport = ElementPassport(Element=graphical_element_5)  # -> DocumentGUID, Document, UniqueID, Id
query_element = QueryElement(Id=element_passport.Id)

# ---- group: Rotates line wrong first / Guide line
line_9 = Line(graphical_element_4)

# ----
curve_middle_2 = CurveMiddle(Curve=stream_filter)
active_view_2 = ActiveView()
plane = Plane(active_view_2)
host_inserts = HostInserts(Host=query_element)  # -> Inserts, Shared, Shadows, Openings, Walls
element_location = ElementLocation(Element=simplify(host_inserts.Inserts))  # -> Element, Location
point = Point(element_location.Location)

deconstruct_plane = DeconstructPlane(Plane=plane)  # -> Origin, XAxis, YAxis, ZAxis
construct_plane = ConstructPlane(Origin=curve_middle_2, XAxis=deconstruct_plane.XAxis, YAxis=deconstruct_plane.YAxis)

# ---- group: Rotates line wrong first
radians = Radians(Degrees="0.1")
rotate = Rotate(Geometry=stream_filter, Angle=radians, Plane=construct_plane)  # -> Geometry, Transform
flip_curve_2 = FlipCurve(Curve=rotate.Geometry, Guide=simplify(graft(line_9)))  # -> reparameterize(Curve), Flag
element_curve = ElementCurve(Element=simplify(graft(graphical_element_5)), Curve=flip_curve_2.Curve, FailureProcessingMode=1)  # -> Element, Curve

# ----
list_length_3 = ListLength(List=host_inserts.Inserts)

# ---- group: And to correct position
element_curve_2 = ElementCurve(Element=element_curve.Element, Curve=stream_filter, FailureProcessingMode=1)  # -> Element, Curve

# ----
boolean_3 = Boolean(list_length_3)
addition = Addition(A=boolean_3, B="0")

line_10 = Line(element_curve_2.Element)
curve_closest_point = CurveClosestPoint(Point=point, Curve=reparameterize(simplify(graft(line_10))))  # -> simplify(Point), Parameter, Distance
project = Project(Geometry=curve_closest_point.Point, Plane=element_location.Location)  # -> Geometry, Transform
stream_filter_2 = StreamFilter(Gate=addition, Stream1=project.Geometry)
element_location_2 = ElementLocation(Element=simplify(graft(host_inserts.Inserts)), Location=simplify(graft(stream_filter_2)), FailureProcessingMode=2)  # -> Element, Location, Hand, Facing, WorkPlane
